# Dynamo graph HeatSeriesCharts.dyn (Dynamo 2.2.0.3994)

code_block = CodeBlock()
# ---------- code_block.designscript (22 lines) ----------
[
	"User-1",
	"User-2",
	"User-3",
	"User-4",
	"User-5"
];

[
	"Option-1",
	"Option-2",
	"Option-3"
];

[
	[0, 1, 2],
	[3, 4, 5],
	[6, 7, 8],
	[9, 10, 11],
	[12, 13, 14]
];
[];
# ----------------------------------------
code_block_2 = CodeBlock()
# ---------- code_block_2.designscript (4 lines) ----------
[
	Color.ByARGB(255, 255, 0, 0),
	Color.ByARGB(255, 0, 0, 255)
];
# ----------------------------------------
heat_series_plot = HeatSeriesNodeModel(x_labels=code_block.out0, y_labels=code_block.out1, values=code_block.out2, colors=code_block_2, XLabels=["User-1", "User-2", "User-3", "User-4", "User-5"], YLabels=["Option-1", "Option-2", "Option-3"], Values=[[0, 1, 2], [3, 4, 5], [6, 7, 8], [9, 10, 11], [12, 13, 14]], Colors=["#FFFF0000", "#FF0000FF"])
