# Dynamo graph PieCharts.dyn "PieChart" (Dynamo 2.2.0.3845)

number_slider = DoubleSlider(45, range=0..100 step 0.1)
code_block = CodeBlock(x=number_slider) { ["Person1", "Person2", "Person3"]; [x, 50.5, 100.4]; }
color_palette = ColorPalette({R: 220, G: 20, B: 60, A: 255})
color_palette_2 = ColorPalette({R: 0, G: 255, B: 0, A: 255})
color_palette_3 = ColorPalette({R: 0, G: 0, B: 255, A: 255})
list_create = List.Create(item0=color_palette, item1=color_palette_2, item2=color_palette_3)
pie = PieChartNodeModel(labels=code_block.out0, values=code_block.out1, color=list_create, Labels=["Person1", "Person2", "Person3"], Values=[45, 50.5, 100.4], Colors=["#FFDC143C", "#FF00FF00", "#FF0000FF"])
code_block_2 = CodeBlock(x=number_slider)
# ---------- code_block_2.designscript (11 lines) ----------
chartData =
{
	"alfarok" : x,
	"Person2" : 150,
	"Person3" : 150,
	"Person4" : 150
};

chartData.Keys;
chartData.Values;
[];
# ----------------------------------------
pie_2 = PieChartNodeModel(labels=code_block_2.out1, values=code_block_2.out2, color=code_block_2.out3, Labels=["alfarok", "Person2", "Person3", "Person4"], Values=[45, 150, 150, 150], Colors=["#FF0B49AE", "#FF9E5FCB", "#FF4FA31E", "#FF4277C3"])
pie_3 = PieChartNodeModel()  # unwired: labels, values, color
