# Dynamo graph ShapingFunctions.dyn (Dynamo 2.2.0.3994)

# group: Labels/Color
code_block = CodeBlock { ["ShapingFunction"]; [Color.ByARGB(255,255,0,0)]; }

# group: Range
code_block_2 = CodeBlock { -1; 1; 0.1; }
range = Range(start=code_block_2.out0, end=code_block_2.out1, step=code_block_2.out2)

number_slider = DoubleSlider(0.5, range=0..3.5 step 0.1)
code_block_3 = CodeBlock(x=range, pow=number_slider) { 1-Math.Pow(Math.Abs(x), pow); }
code_block_4 = CodeBlock(xvalues=range, yvalues=code_block_3) { [xvalues]; [yvalues]; }
xy_line = XYLineChartNodeModel(labels=code_block.out0, x_values=code_block_4.out0, y_values=code_block_4.out1, colors=code_block.out1, Labels=["ShapingFunction"], XValues=[[-1, -0.9, -0.8, -0.7, -0.6, -0.5, -0.4, -0.3, -0.2, -0.1, 0, 0.1, 0.2, 0.3, 0.4, 0.5, 0.6, 0.7, 0.8, 0.9, 1]], YValues=[[0, 0.05131670195, 0.105572809, 0.1633399735, 0.2254033308, 0.2928932188, 0.367544468, 0.4522774425, 0.5527864045, 0.683772234, 1, 0.683772234, 0.5527864045, 0.4522774425, 0.367544468, 0.2928932188, 0.2254033308, 0.1633399735, 0.105572809, 0.05131670195, 0]], Colors=["#FFFF0000"])
number_slider_2 = DoubleSlider(0.5, range=0..3.5 step 0.1)
code_block_5 = CodeBlock(x=range, pow=number_slider_2) { Math.Pow(Math.Cos(Math.PI * x / 2.0), pow); }
code_block_6 = CodeBlock(xvalues=range, yvalues=code_block_5) { [xvalues]; [yvalues]; }
xy_line_2 = XYLineChartNodeModel(labels=code_block.out0, x_values=code_block_6.out0, y_values=code_block_6.out1, colors=code_block.out1, Labels=["ShapingFunction"], XValues=[[-1, -0.9, -0.8, -0.7, -0.6, -0.5, -0.4, -0.3, -0.2, -0.1, 0, 0.1, 0.2, 0.3, 0.4, 0.5, 0.6, 0.7, 0.8, 0.9, 1]], YValues=[[0.9998120908, 0.9998477944, 0.9998797395, 0.999907926, 0.999932354, 0.9999530238, 0.9999699353, 0.9999830887, 0.9999924839, 0.999998121, 1, 0.999998121, 0.9999924839, 0.9999830887, 0.9999699353, 0.9999530238, 0.999932354, 0.999907926, 0.9998797395, 0.9998477944, 0.9998120908]], Colors=["#FFFF0000"])
number_slider_3 = DoubleSlider(3.5, range=0..3.5 step 0.1)
code_block_7 = CodeBlock(x=range, pow=number_slider_3) { 1 - Math.Pow(Math.Abs(Math.Sin(Math.PI * x / 2.0)), pow); }
code_block_8 = CodeBlock(xvalues=range, yvalues=code_block_7) { [xvalues]; [yvalues]; }
xy_line_3 = XYLineChartNodeModel(labels=code_block.out0, x_values=code_block_8.out0, y_values=code_block_8.out1, colors=code_block.out1, Labels=["ShapingFunction"], XValues=[[-1, -0.9, -0.8, -0.7, -0.6, -0.5, -0.4, -0.3, -0.2, -0.1, 0, 0.1, 0.2, 0.3, 0.4, 0.5, 0.6, 0.7, 0.8, 0.9, 1]], YValues=[[0.9999965896, 0.9999976412, 0.999998438, 0.9999990211, 0.9999994292, 0.9999996985, 0.9999998619, 0.9999999495, 0.9999999878, 0.9999999989, 1, 0.9999999989, 0.9999999878, 0.9999999495, 0.9999998619, 0.9999996985, 0.9999994292, 0.9999990211, 0.999998438, 0.9999976412, 0.9999965896]], Colors=["#FFFF0000"])
number_slider_4 = DoubleSlider(0.5, range=0..3.5 step 0.1)
code_block_9 = CodeBlock(x=range, pow=number_slider_4) { Math.Pow(Math.Min(Math.Cos(Math.PI * x / 2.0), 1.0 - Math.Abs(x)), pow); }
code_block_10 = CodeBlock(xvalues=range, yvalues=code_block_9) { [xvalues]; [yvalues]; }
xy_line_4 = XYLineChartNodeModel(labels=code_block.out0, x_values=code_block_10.out0, y_values=code_block_10.out1, colors=code_block.out1, Labels=["ShapingFunction"], XValues=[[-1, -0.9, -0.8, -0.7, -0.6, -0.5, -0.4, -0.3, -0.2, -0.1, 0, 0.1, 0.2, 0.3, 0.4, 0.5, 0.6, 0.7, 0.8, 0.9, 1]], YValues=[[0, 0.316227766, 0.4472135955, 0.5477225575, 0.632455532, 0.7071067812, 0.7745966692, 0.8366600265, 0.894427191, 0.9486832981, 1, 0.9486832981, 0.894427191, 0.8366600265, 0.7745966692, 0.7071067812, 0.632455532, 0.5477225575, 0.4472135955, 0.316227766, 0]], Colors=["#FFFF0000"])
number_slider_5 = DoubleSlider(0.5, range=0..3.5 step 0.1)
code_block_11 = CodeBlock(x=range, pow=number_slider_5) { 1.0 - Math.Pow(Math.Max(0, (Math.Abs(x) * 2.0 - 1.0)), pow); }
code_block_12 = CodeBlock(xvalues=range, yvalues=code_block_11) { [xvalues]; [yvalues]; }
xy_line_5 = XYLineChartNodeModel(labels=code_block.out0, x_values=code_block_12.out0, y_values=code_block_12.out1, colors=code_block.out1, Labels=["ShapingFunction"], XValues=[[-1, -0.9, -0.8, -0.7, -0.6, -0.5, -0.4, -0.3, -0.2, -0.1, 0, 0.1, 0.2, 0.3, 0.4, 0.5, 0.6, 0.7, 0.8, 0.9, 1]], YValues=[[0, 0.105572809, 0.2254033308, 0.367544468, 0.5527864045, 1, 1, 1, 1, 1, 1, 1, 1, 1, 1, 1, 0.5527864045, 0.367544468, 0.2254033308, 0.105572809, 0]], Colors=["#FFFF0000"])
