# Dynamo graph XYLineCharts.dyn (Dynamo 2.2.0.3994)

integer_slider = IntegerSlider(2, range=-10..10 step 1)
color_palette = ColorPalette({R: 255, G: 127, B: 80, A: 255})
code_block = CodeBlock(slide=integer_slider, color=color_palette) { ["MyLine"]; [[0, 1, 2]]; [[0, slide, 0]]; [color]; }
xy_line = XYLineChartNodeModel(labels=code_block.out0, x_values=code_block.out1, y_values=code_block.out2, colors=code_block.out3, Labels=["MyLine"], XValues=[[0, 1, 2]], YValues=[[0, 2, 0]], Colors=["#FFFF7F50"])
piTimes2 = Math.PiTimes2()
code_block_2 = CodeBlock(x=piTimes2) { -x; x/8; }
range = Range(start=code_block_2.out0, end=piTimes2, step=code_block_2.out1)
code_block_3 = CodeBlock(range=range) { labels = ["Sine", "Cosine"]; xVals = [range, range]; }
radiansToDegrees = Math.RadiansToDegrees(radians=range)
sin = Math.Sin(angle=radiansToDegrees)
cos = Math.Cos(angle=radiansToDegrees)
list_create = List.Create(item0=sin, item1=cos)
color_palette_2 = ColorPalette({R: 255, G: 69, B: 0, A: 255})
color_palette_3 = ColorPalette({R: 30, G: 144, B: 255, A: 255})
list_create_2 = List.Create(item0=color_palette_2, item1=color_palette_3)
xy_line_2 = XYLineChartNodeModel(labels=code_block_3.labels, x_values=code_block_3.xVals, y_values=list_create, colors=list_create_2, Labels=["Sine", "Cosine"], Colors=["#FFFF4500", "#FF1E90FF"])
xy_line_plot = XYLineChartNodeModel()  # unwired: labels, x_values, y_values, colors
